# Grasshopper definition PlanarMeshWithGeodesicExample.ghx (Grasshopper 0.9.61)
# plug-ins: PlanarMesh, GeodesicComponent

number_slider = Slider(1, range=0..1)
ih = Icosahedron(Radius=number_slider)
geo = GeodesicSubdivision(Mesh=ih, Radius=number_slider, Subdivisions=Slider(2, range=0..10))
pm = PlanariseMesh(Mesh=geo, Metric=1, NumberOfPanels=Slider(30, range=0..100), Run=Toggle(True))  # -> Output, Proxies, MeshAsCurves, HLwingMesh, Normals, Centres, VoronoiOnMesh
crv = Curve(pm.MeshAsCurves)
boundary = BoundarySurfaces(Edges=crv)
