# Grasshopper definition PlanarMeshExample.ghx (Grasshopper 0.9.61)
# plug-ins: PlanarMesh

mesh = Mesh(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)
pm = PlanariseMesh(Mesh=mesh, Metric=1, NumberOfPanels=Slider(30, range=0..100), Run=Toggle(True))  # -> Output, Proxies, MeshAsCurves, HLwingMesh, Normals, Centres, VoronoiOnMesh
crv = Curve(pm.MeshAsCurves)
boundary = BoundarySurfaces(Edges=crv)
