# Grasshopper definition PlanarMeshExample-Anticlastic.ghx (Grasshopper 0.9.75)
# plug-ins: PlanarMesh, LunchBox

paraboloid = HyperbolicParaboloid(U=32, V=32, a=2, b=2, S=5, D1=Domain(-4, 4), D2=Domain(-4, 4))
mesh = Mesh(paraboloid)
tri = Triangulate(Mesh=mesh)  # -> Mesh, Count
ll = Lloyds(Mesh=tri.Mesh, Metric=Slider(1, range=0..1), NumberOfFacets=Slider(32, range=0..100))
pm = PlanariseMesh(Mesh=ll)  # -> Proxies, MeshAsCurves, Normals, Centres
boundary = BoundarySurfaces(Edges=graft(pm.MeshAsCurves))  # -> flatten(Surfaces)
lng = ListLength(List=boundary)
series = Series(Start=0, Step=1, Count=lng)
gradient = Gradient(
    LowerLimit=0,
    UpperLimit=lng,
    Parameter=series,
    stops=[0: RGB(243, 57, 0), 0.1: RGB(236, 27, 60), 0.2: RGB(210, 0, 118), 0.3: RGB(103, 0, 120), 0.4: RGB(39, 72, 161), 0.5: RGB(1, 192, 229), 0.6: RGB(18, 178, 90), 0.7: RGB(79, 186, 8), 0.8: RGB(220, 237, 32), 0.9: RGB(247, 159, 20), 1: RGB(243, 57, 0)])
preview = CustomPreview(Geometry=boundary, Shader=gradient)
