# Grasshopper definition PlanarMeshExample.ghx (Grasshopper 0.9.75)
# plug-ins: PlanarMesh, Weaverbird

wbicosahedron = WeaverbirdsMeshMeshIcosahedron(Plane=PlaneXY(0, 0, 0), Radius=10)  # disabled
mesh = Mesh(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)
wbloop = WeaverbirdsLoopSubdivision(MeshCurves=wbicosahedron, Level=1, SmoothNakedEdges=1)  # disabled
ll = Lloyds(Mesh=mesh, Metric=Slider(1, range=0..1), NumberOfFacets=Slider(30, range=0..100))
wbdual = WeaverbirdsDualGraph(MeshCurves=wbloop, DualMode=0)  # disabled
boundary = BoundarySurfaces(Edges=graft(wbdual))  # disabled
pm = PlanariseMesh(Mesh=ll)  # -> Proxies, MeshAsCurves, Normals, Centres
pm_2 = PlanariseMesh(Mesh=wbdual)  # -> Proxies, MeshAsCurves, Normals, Centres; disabled
boundary_2 = BoundarySurfaces(Edges=graft(pm.MeshAsCurves))
boundary_3 = BoundarySurfaces(Edges=graft(pm_2.MeshAsCurves))  # disabled
