# Grasshopper definition PlanarMeshWithStarlingExample.ghx (Grasshopper 0.9.75)
# plug-ins: PlanarMesh, Starling

mesh = Mesh(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)
ll = Lloyds(Mesh=mesh, Metric=1, NumberOfFacets=Slider(29, range=0..100))
pm = PlanariseMesh(Mesh=ll)  # -> Proxies, MeshAsCurves, Normals, Centres
crv = Curve(pm.MeshAsCurves)

# ---- group: Rebuild a face using starling
lng = ListLength(List=crv)
multiplication = Multiplication(A=lng, B=Slider(1, range=0..1))
series = Series(Start=0, Step=1, Count=multiplication)
pmcomp = PmDecompose(Polylines=crv)  # -> Vertices, Faces
path = ConstructPath(Indices=graft(series))
branch = TreeBranch(Tree=pmcomp.Faces, Path=path, MaintainPaths=True)
item = ListItem(List=pmcomp.Vertices, Index=branch, Wrap=True)
pline = PolyLine(Vertices=item, Closed=False)
srf = Surface(pline)
preview = CustomPreview(Geometry=srf, Shader=ColourSwatch(SwatchColor=RGBA(255, 255, 255, 87)))

# ---- group: Create the dual using starling
pmdual = PmDual(Polylines=crv, Type=0)
boundary = BoundarySurfaces(Edges=pmdual)
preview_2 = CustomPreview(Geometry=boundary, Shader=ColourSwatch(SwatchColor=RGB(33, 33, 33)))
