# Grasshopper definition PlanarMeshWithWbExample.ghx (Grasshopper 0.9.75)
# plug-ins: PlanarMesh, Weaverbird

wbicosahedron = WeaverbirdsMeshMeshIcosahedron(Plane=PlaneXY(0, 0, 0), Radius=10)
wbloop = WeaverbirdsLoopSubdivision(MeshCurves=wbicosahedron, Level=1, SmoothNakedEdges=1)
wbdual = WeaverbirdsDualGraph(MeshCurves=wbloop, DualMode=0)
pm = PlanariseMesh(Mesh=wbdual)  # -> Proxies, MeshAsCurves, Normals, Centres
pcen = PolygonCenter(Polyline=pm.MeshAsCurves)  # -> CenterV, CenterE, CenterA
srf = Surface(pm.MeshAsCurves)

# ---- group: Are all curves planar?
allplanar = AllPlanar(crv=pm.MeshAsCurves)
panel = Panel(allplanar)

# ----
scale = Scale(Geometry=pm.MeshAsCurves, Center=pcen.CenterV, Factor=0.5)  # -> Geometry, Transform
srfsplit = SurfaceSplit(Surface=graft(srf), Curves=graft(scale.Geometry))
item = ListItem(List=srfsplit, Index=0, Wrap=True)  # -> flatten(Item)
lng = ListLength(List=item)
series = Series(Start=0, Step=1, Count=lng)
gradient = Gradient(
    LowerLimit=0,
    UpperLimit=lng,
    Parameter=series,
    stops=[0: RGB(243, 57, 0), 0.1: RGB(236, 27, 60), 0.2: RGB(210, 0, 118), 0.3: RGB(103, 0, 120), 0.4: RGB(39, 72, 161), 0.5: RGB(1, 192, 229), 0.6: RGB(18, 178, 90), 0.7: RGB(79, 186, 8), 0.8: RGB(220, 237, 32), 0.9: RGB(247, 159, 20), 1: RGB(243, 57, 0)])
preview = CustomPreview(Geometry=item, Shader=gradient)

# ==== cluster AllPlanar: Returns true if all curves are planar
crv = ClusterInput()
crv_2 = Curve(crv)
planar = Planar(Curve=crv_2)  # -> Planar, Plane, Deviation
lng = ListLength(List=crv_2)
lng_2 = ListLength(List=planar.Planar)
equals = Equality(FirstNumber=lng_2, SecondNumber=lng)  # -> Equality, Inequality
equality = ClusterOutput(equals.Equality)
